# Dynamo graph rutina_json.dyn (Dynamo 3.3.0.6316)

python_script = Python()  # CPython3; unwired: IN[0]
# ---------- python_script.python (51 lines) ----------
import clr
clr.AddReference('RevitServices')
clr.AddReference('RevitAPI')
from RevitServices.Persistence import DocumentManager
from Autodesk.Revit.DB import FilteredElementCollector, BuiltInCategory, LocationCurve

doc = DocumentManager.Instance.CurrentDBDocument

def get_param(elem, nombre):
    try:
        p = elem.LookupParameter(nombre)
        if p is None: return ""
        return p.AsString() or str(p.AsValueString()) or ""
    except: return ""

def pt(p):
    return {"x": round(p.X*0.3048,4), "y": round(p.Y*0.3048,4), "z": round(p.Z*0.3048,4)}

vigas_raw = list(FilteredElementCollector(doc).OfCategory(BuiltInCategory.OST_StructuralFraming).WhereElementIsNotElementType().ToElements())
cols_raw = list(FilteredElementCollector(doc).OfCategory(BuiltInCategory.OST_StructuralColumns).WhereElementIsNotElementType().ToElements())

vigas = []
for v in vigas_raw:
    try:
        loc = v.Location
        if not isinstance(loc, LocationCurve): continue
        c = loc.Curve
        vigas.append({
            "id":      v.Id.IntegerValue,
            "marca":   get_param(v,"Mark") or "VG-"+str(v.Id.IntegerValue),
            "nivel":   get_param(v,"Nivel de referencia"),
            "seccion": v.Name,
            "inicio":  pt(c.GetEndPoint(0)),
            "fin":     pt(c.GetEndPoint(1))
        })
    except: continue

cols = []
for c in cols_raw:
    try:
        loc = c.Location
        if not isinstance(loc, LocationCurve): continue
        cv = loc.Curve
        cols.append({
            "id":   c.Id.IntegerValue,
            "base": pt(cv.GetEndPoint(0)),
            "tope": pt(cv.GetEndPoint(1))
        })
    except: continue

OUT = [vigas, cols, "Vigas: "+str(len(vigas))+" | Columnas: "+str(len(cols))]
# ----------------------------------------
watch = Watch(python_script)
python_script_2 = Python(IN[0]=python_script)  # CPython3
# ---------- python_script_2.python (44 lines) ----------
import clr
clr.AddReference('RevitServices')
clr.AddReference('RevitAPI')
from RevitServices.Persistence import DocumentManager
from Autodesk.Revit.DB import FilteredElementCollector, BuiltInCategory, LocationCurve
import math

doc = DocumentManager.Instance.CurrentDBDocument

def get_param(elem, nombre):
    try:
        p = elem.LookupParameter(nombre)
        if p is None: return ""
        return p.AsString() or str(p.AsValueString()) or ""
    except: return ""

def pt(p):
    return {"x": round(p.X*0.3048,4), "y": round(p.Y*0.3048,4), "z": round(p.Z*0.3048,4)}

def lon3d(p1, p2):
    return round(math.sqrt((p2["x"]-p1["x"])**2+(p2["y"]-p1["y"])**2+(p2["z"]-p1["z"])**2),4)

vigas_raw = list(FilteredElementCollector(doc).OfCategory(BuiltInCategory.OST_StructuralFraming).WhereElementIsNotElementType().ToElements())

resultado = []
for v in vigas_raw:
    try:
        loc = v.Location
        if not isinstance(loc, LocationCurve): continue
        c = loc.Curve
        inicio  = pt(c.GetEndPoint(0))
        fin     = pt(c.GetEndPoint(1))
        resultado.append({
            "id":       v.Id.IntegerValue,
            "marca":    get_param(v,"Mark") or "VG-"+str(v.Id.IntegerValue),
            "nivel":    get_param(v,"Nivel de referencia"),
            "seccion":  v.Name,
            "inicio":   inicio,
            "fin":      fin,
            "longitud": lon3d(inicio, fin)
        })
    except: continue

OUT = resultado
# ----------------------------------------
watch_2 = Watch(python_script_2)
python_script_3 = Python()  # CPython3; unwired: IN[0]
# ---------- python_script_3.python (58 lines) ----------
import clr
clr.AddReference('RevitServices')
clr.AddReference('RevitAPI')
from RevitServices.Persistence import DocumentManager
from Autodesk.Revit.DB import FilteredElementCollector, BuiltInCategory, LocationCurve
import math, json, os
from datetime import date

doc = DocumentManager.Instance.CurrentDBDocument

def get_param(elem, nombre):
    try:
        p = elem.LookupParameter(nombre)
        if p is None: return ""
        return p.AsString() or str(p.AsValueString()) or ""
    except: return ""

def pt(p):
    return {"x": round(float(p.X)*0.3048,4), "y": round(float(p.Y)*0.3048,4), "z": round(float(p.Z)*0.3048,4)}

def lon3d(p1, p2):
    return round(math.sqrt((p2["x"]-p1["x"])**2+(p2["y"]-p1["y"])**2+(p2["z"]-p1["z"])**2),4)

vigas_raw = list(FilteredElementCollector(doc).OfCategory(BuiltInCategory.OST_StructuralFraming).WhereElementIsNotElementType().ToElements())

elementos = []
for v in vigas_raw:
    try:
        loc = v.Location
        if not isinstance(loc, LocationCurve): continue
        c = loc.Curve
        inicio  = pt(c.GetEndPoint(0))
        fin     = pt(c.GetEndPoint(1))
        elementos.append({
            "id":       int(v.Id.IntegerValue),
            "marca":    str(get_param(v,"Mark") or "VG-"+str(v.Id.IntegerValue)),
            "nivel":    str(get_param(v,"Nivel de referencia")),
            "seccion":  str(v.Name),
            "inicio":   inicio,
            "fin":      fin,
            "longitud": lon3d(inicio, fin)
        })
    except: continue

ruta = "D:/Documents/01_Programas/Programa_despieces/vigas.json"

payload = {
    "proyecto": "PROYECTO_INICIAL",
    "fecha":    str(date.today()),
    "unidades": "metros",
    "elementos": elementos
}

os.makedirs(os.path.dirname(ruta), exist_ok=True)
with open(ruta, "w", encoding="utf-8") as f:
    json.dump(payload, f, indent=2, ensure_ascii=False)

OUT = "Exportado: " + ruta + " — " + str(len(elementos)) + " elementos"
# ----------------------------------------
